# Grasshopper definition PointCloud.gh (Grasshopper 1.0.7)

websocket_client_start = WebsocketClientStart(Address="ws://localhost:8787", InitalMessage=Slider(7, range=0..7), Reset=Button())
websocket_client_receiver = WebsocketClientReceiver(WebsocketObjects=websocket_client_start, AutoUpdate=True)  # -> Message, Status
python = GhPythonScript(msg=websocket_client_receiver.Message)  # -> out, points_out
# ---------- python: Python ----------
import json
import rhinoscriptsyntax as rs


points_out = []
if msg is not None:
    points = json.loads(msg)
    points_out = [rs.CreatePoint(x,y,z) for (x,y,z) in points]
    print (len(points))
# ---------- end python ----------
lng = ListLength(List=python.points_out)
scale = Scale(Geometry=python.points_out, Center=Point(0, 0, 0), Factor=Slider(1000, range=0..1000))  # -> Geometry, Transform
panel = Panel(lng)
